vi "Reset Aggregates.gviweb"   [LabVIEW NXG 2.0.0]
inputs:
  "Server": string
  "Tag": string
panel indicators:
  "url": string
  "error out": error
  "body": string
uses:
  NI::HTTP::POST Buffer.gvi
diagram:
  Concatenate Strings("http://", $Server, "/nitag/v1/tags/", $Tag, "/reset-aggregates") -> w1
  call "POST Buffer.gvi"(url=w1) -> (body=w2, error out=w3)
  $body <- w2
  $url <- w1
  $"error out" <- w3
