vi "Main.gviweb"   [LabVIEW NXG 2.0.0]
panel indicators:
  "Value": f64
  "error out": error
uses:
  NI Skyline Tag Web API::Create Configuration.gvi
  NI Skyline Tag Web API::Open Tag (DBL).gvi
  NI Skyline Tag Web API::Read Tag (DBL).gvi
  NI Skyline Tag Web API::Close Tag (Single).gvi
diagram:
  call "Create Configuration.gvi"(Machine name="ec2-34-202-230-132.compute-1.amazonaws.com", Username="", Password="") -> (Configuration=w1, error out=w2)
  call "Open Tag (DBL).gvi"(Tag path="testing", Configuration=w1, Collect aggregates? (F)=TRUE, error in (no error)=w2) -> (Tag=w3, error out=w4)
  call "Read Tag (DBL).gvi"(Tag in=w3, error in (no error)=w4) -> (Tag out=w5, Value=w6, error out=w7)
  $Value <- w6
  call "Close Tag (Single).gvi"(Tag=w5, error in (no error)=w7) -> (error out=w8)
  $"error out" <- w8
